# Grasshopper definition ClosedObjectbff.gh (Grasshopper 1.0.7)
# plug-ins: BoundaryFirstFlatterningMac

simple_open_mesh = Mesh(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)
boundaryfirstflatenning = BoundaryFirstFlatenning(
    Mesh=simple_open_mesh,
    MapToSphere=Slider(2, range=0..2),
    NCones=Slider(0, range=0..20),
    NormalizeUVs=Toggle(False),
    VertexOrder=Toggle(False))  # -> Mesh3D, Mesh2D

# ---- group: Change the V input and check the order
demesh = DeconstructMesh(Mesh=boundaryfirstflatenning.Mesh2D)  # -> Vertices, Faces, Colours, Normals
demesh_2 = DeconstructMesh(Mesh=boundaryfirstflatenning.Mesh3D)  # -> Vertices, Faces, Colours, Normals
ln = Line(StartPoint=demesh.Vertices, EndPoint=demesh_2.Vertices)

# ----
crv = Curve(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)
mappolylines = MapPolylines(Curves=crv, Mesh0=boundaryfirstflatenning.Mesh2D, Mesh1=boundaryfirstflatenning.Mesh3D)
preview = CustomPreview(Geometry=mappolylines, Material=ColourSwatch(SwatchColor=RGB(0, 47, 255)))

bunny = Mesh(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)
boundaryfirstflatenning_2 = BoundaryFirstFlatenning(
    Mesh=bunny,
    MapToSphere=Slider(1, range=0..2),
    NCones=Slider(0, range=0..20),
    NormalizeUVs=Toggle(False),
    VertexOrder=Toggle(True))  # -> Mesh3D, Mesh2D

# ---- group: Slice the sphere
range = Range(Domain="-1 to 1", Steps=Slider(71, range=0..100))
xy = XYPlane(Origin=Point(0, 0, 0))
contour = ContourEx(Shape=boundaryfirstflatenning_2.Mesh2D, Plane=xy, Offsets=range)  # -> flatten(Contours)

# ----
crv_2 = Curve(contour)
mappolylines_2 = MapPolylines(Curves=crv_2, Mesh0=boundaryfirstflatenning_2.Mesh2D, Mesh1=boundaryfirstflatenning_2.Mesh3D)
preview_2 = CustomPreview(Geometry=mappolylines_2, Material=ColourSwatch(SwatchColor=RGB(0, 106, 255)))
