# Grasshopper definition TestWindowsOrMac.gh (Grasshopper 1.0.7)

c_script = CSharpScript()  # -> out, A
# ---------- c_script: C# ----------
A = System.Runtime.InteropServices.RuntimeInformation.IsOSPlatform(System.Runtime.InteropServices.OSPlatform.Windows);
# ---------- end c_script ----------
panel = Panel(c_script.A)
